# Grasshopper definition 0208.gh (Grasshopper 1.0.7)
# plug-ins: ClipperComponents, VolumeGeneratorBasedOnGraph

panel = Panel("""W
S
E
N""")
point = Point([Point(0, 25, 0), Point(-24, -1, 0), Point(15, -9, 0)])
point_2 = Point([Point(-58.07877569, -0.1938198873, 0), Point(1.315160513, -41.54792591, 0), Point(52.69083492, -0.1938198873, 0), Point(-1.182268104, 47.28917775, 0)])
file_path = FilePath("D:\毕业论文\VolumeGeneratorBasedOnGraph\VolumeGeneratorBasedOnGraph\测试文件夹\1221Test.csv")
constructgraph = ConstructGraph(CSVFilePath=file_path, VolumeNodePoints=point, BoundaryNodePoints=point_2, BoundaryNodeLabels=panel)
tutteconvexdrawing = TutteConvexDrawing(Graph=constructgraph)  # -> Graph, ConvexFaceBorders, SubGraph, GraphEdge
# 缺口形
curve = Curve(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)
# 正交矩形
# 四边形
curve_2 = Curve(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)
explode = Explode(Curve=curve_2, Recursive=True)  # -> Segments, Vertices
list_item = ListItem(List=explode.Segments, Index=" 0", Wrap=True)
list_item_2 = ListItem(List=explode.Segments, Index="3", Wrap=True)
list_item_3 = ListItem(List=explode.Segments, Index="2", Wrap=True)
list_item_4 = ListItem(List=explode.Segments, Index="1", Wrap=True)
line = Line(list_item)
line_2 = Line(list_item_2)
line_3 = Line(list_item_3)
line_4 = Line(list_item_4)
constructboundarysegment = ConstructBoundarySegment(SelectedBoundaryPolylineSegment=line_2, SegmentLabel="N")
constructboundarysegment_2 = ConstructBoundarySegment(SelectedBoundaryPolylineSegment=line_3, SegmentLabel="E")
constructboundarysegment_3 = ConstructBoundarySegment(SelectedBoundaryPolylineSegment=line_4, SegmentLabel="S")
constructboundarysegment_4 = ConstructBoundarySegment(SelectedBoundaryPolylineSegment=line, SegmentLabel="W")
merge = Merge(
    Data1=constructboundarysegment_4,
    Data2=constructboundarysegment_3,
    Data3=constructboundarysegment_2,
    Data4=constructboundarysegment)
triangulate = Triangulate(
    Graph=tutteconvexdrawing.Graph,
    ConvexFaceBorders=tutteconvexdrawing.ConvexFaceBorders,
    IndexOfTriangularMesh=Slider(0, range=0..12),
    ExcludeDegenerateTINS=Toggle(True))
dualusinghalfedge2 = DualUsingHalfedge2(GraphWithHM=triangulate)
reorganizeboundary3 = ReorganizeBoundary3(DualGraphWithHM=dualusinghalfedge2, BoundarySegments=merge)  # -> SortedBoundarySegments, VerticesIndexForEachBS, IndexOnEachBS, VolumeJunctionsTexts, NeedToConnectVolumeJunctionsIndex, NeedToConnectBSIndex, NeedToConnectPairCorrespondingFaceIndex, BoundaryTCounts, InnerTMaxCounts, TotalLayerCount
gene_pool = GenePool(Decimals=2, Maximum=1, Minimum=0, Value=1)
gene_pool_2 = GenePool(Decimals=2, Maximum=1, Minimum=0, Value=[0.33, 0.46, 0.43])
entwine = Entwine(Branch00=gene_pool_2, FlattenInputs=True)
entwine_2 = Entwine(Branch00=gene_pool, FlattenInputs=True)
ghcsitedivision3 = GhcSiteDivision3(
    DualGraphWithHM=dualusinghalfedge2,
    SortedBoundarySegments=reorganizeboundary3.SortedBoundarySegments,
    VerticesIndexForEachBS=reorganizeboundary3.VerticesIndexForEachBS,
    IndexOnEachBS=reorganizeboundary3.IndexOnEachBS,
    VolumeJunctionsTexts=reorganizeboundary3.VolumeJunctionsTexts,
    NeedToConnectVolumeJunctionsIndex=reorganizeboundary3.NeedToConnectVolumeJunctionsIndex,
    NeedToConnectBSIndex=reorganizeboundary3.NeedToConnectBSIndex,
    NeedToConnectPairCorrespondingFaceIndex=reorganizeboundary3.NeedToConnectPairCorrespondingFaceIndex,
    BoundaryTCounts=reorganizeboundary3.BoundaryTCounts,
    InnerTMaxCounts=reorganizeboundary3.InnerTMaxCounts,
    TotalLayerCount=reorganizeboundary3.TotalLayerCount,
    BoundaryTDT=entwine,
    InnerTMaxDT=entwine_2)  # -> TXDT, TYDT, DualGraphWithHM, DualPlanktonMesh

# ----
# W
# S
# E
# N
# default
number_slider = Slider(2, range=0..10)
merge_2 = Merge(
    Data1=Slider(2, range=0..10),
    Data2=number_slider,
    Data3=Slider(2, range=0..10),
    Data4=Slider(2, range=0..10),
    Data5=Slider(2, range=0..10))

curve_3 = Curve(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)
curve_4 = Curve(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)
curve_5 = Curve(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)
gene_pool_3 = GenePool(Decimals=1, Maximum=5, Minimum=-5, Value=[0, 2.5])
gene_pool_4 = GenePool(Decimals=0, Maximum=2, Minimum=0, Value=[1, 2])
unit_z = UnitZ(Factor=1)
boundary_surfaces = BoundarySurfaces(Edges=curve_4)  # -> reparameterize(Surfaces)
brep_wireframe = BrepWireframe(Brep=curve_4, Density=-1)
extrude = Extrude(Base=curve_2, Direction=unit_z)
entwine_3 = Entwine(Branch0X=gene_pool_4, FlattenInputs=False)
entwine_4 = Entwine(Branch0X=gene_pool_3, FlattenInputs=False)
list_item_5 = ListItem(List=brep_wireframe, Index=Slider(2, range=0..10), Wrap=True)
list_item_6 = ListItem(List=brep_wireframe, Index=Slider(3, range=0..10), Wrap=True)
list_item_7 = ListItem(List=brep_wireframe, Index=Slider(1, range=0..10), Wrap=True)
list_item_8 = ListItem(List=brep_wireframe, Index=Slider(0, range=0..10), Wrap=True)
cap_holes = CapHoles(Brep=extrude)
flip_curve = FlipCurve(Curve=list_item_8)  # -> Curve, Flag
flip_curve_2 = FlipCurve(Curve=list_item_6)  # -> Curve, Flag
box = Box(cap_holes)
number_slider_2 = Slider(1.377, range=0..10)
merge_3 = Merge(Data1=flip_curve.Curve, Data2=list_item_5)
construct_domain = ConstructDomain(DomainStart=0, DomainEnd=1)
sweep2 = Sweep2(Rail1=list_item_7, Rail2=flip_curve_2.Curve, Sections=merge_3, SameHeight=False)

# ---- group: AreaRatio
merge_4 = Merge(Data1=Slider(0.29, range=0..3), Data2=Slider(0.29, range=0..3), Data3=Slider(0.29, range=0..3))

# ---- group: Density
merge_5 = Merge(Data1=Slider(0.29, range=0..1), Data2=Slider(0.268, range=0..1), Data3=Slider(0.325, range=0..1))

# ----
multiplication = Multiplication(A=Slider(1, range=0..20), B=number_slider_2)
multiplication_2 = Multiplication(A=Slider(3, range=0..5), B=number_slider_2)
multiplication_3 = Multiplication(A=Slider(5, range=0..10), B=number_slider_2)
multiplication_4 = Multiplication(A=Slider(1.401, range=0..5), B=number_slider_2)
multiplication_5 = Multiplication(A=Slider(2, range=0..10), B=number_slider_2)
surface = Surface(reparameterize(sweep2))
divisionmorph = DivisionMorph(
    DualPlanktonMesh=ghcsitedivision3.DualPlanktonMesh,
    Reference=box,
    Surface=surface,
    UDomain=construct_domain,
    VDomain=construct_domain,
    WDomain=construct_domain)
showgraph = ShowGraph(PlanktonMeshOrGraphWithHFMesh=divisionmorph, OffsetDistance=Slider(0.693, range=0..1), ScreenSize=1, RelativeSize=1)
volumebaseontopo = VolumeBaseOnTopo(
    DualGraphWithHM=ghcsitedivision3.DualGraphWithHM,
    NewDualPlanktonMesh=divisionmorph,
    WhichPairSetbackNeedToChange=entwine_3,
    SetbackValueNeedToChange=entwine_4,
    SetbackList=merge_2,
    W=multiplication,
    W_2=multiplication_2,
    LMin=multiplication_5,
    LMax=multiplication_3,
    D=multiplication_4,
    Density=merge_5,
    AreaRatio=merge_4,
    Seed=Slider(3, range=0..10),
    IsJitter=Toggle(False))  # -> DualGraphWithHMWithBS, SetBackPolyline, Building, Contours, Holes, HCurves, VCurves
curve_6 = Curve([<curve referenced from the Rhino model> x3])
list_length = ListLength(List=curve_6)
series = Series(Start=0, Step=1, Count=list_length)  # -> graft(Series)
number_slider_3 = Slider(0, range=0..10)
curve_7 = Curve(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)
curve_8 = Curve(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)
cull_index = CullIndex(List=curve_6, Indices=series, Wrap=True)
curve_9 = Curve(volumebaseontopo.SetBackPolyline)
explode_tree = ExplodeTree(Data=volumebaseontopo.VCurves)  # -> Branch0, Branch1, Branch2
explode_tree_2 = ExplodeTree(Data=volumebaseontopo.HCurves)  # -> Branch0, Branch1, Branch2
region_difference = RegionDifference(CurvesA=curve_7, CurvesB=curve_8)
curve_10 = Curve(volumebaseontopo.Holes)
curve_11 = Curve(volumebaseontopo.Contours)
brep = Brep(volumebaseontopo.Building)
explode_tree_3 = ExplodeTree(Data=cull_index)  # -> _0000, _0010
curve_curve = CurveCurve(CurveA=graft(curve_6), CurveB=cull_index)  # -> Points, ParamsA, ParamsB
explode_tree_4 = ExplodeTree(Data=curve_11)  # -> Branch0, Branch1, Branch2
explode_tree_5 = ExplodeTree(Data=curve_10)  # -> Branch0, Branch1, Branch2
explode_tree_6 = ExplodeTree(Data=brep)  # -> Branch0, Branch1, Branch2
list_item_9 = ListItem(List=curve_9, Index=Slider(0, range=0..10), Wrap=True)
geometry = Geometry(explode_tree.Branch1)
explode_tree_7 = ExplodeTree()  # -> Branch0, Branch1, Branch2
geometry_2 = Geometry(explode_tree_2.Branch1)
unit_z_2 = UnitZ(Factor=5)
geometry_3 = Geometry(explode_tree_5.Branch1)
geometry_4 = Geometry(explode_tree_4.Branch1)
geometry_5 = Geometry(explode_tree_6.Branch1)
control_points = ControlPoints(Curve=list_item_9)  # -> Points, Weights, Knots
merge_6 = Merge(Data1=explode_tree_2.Branch0, Data2=explode_tree.Branch0)
merge_7 = Merge(Data1=explode_tree_2.Branch1, Data2=explode_tree.Branch1)
list_item_10 = ListItem(List=geometry, Index=Slider(2, range=0..10), Wrap=True)
curve_12 = Curve()
shift_paths = ShiftPaths(Data=curve_curve.ParamsA, Offset=-1)
curve_13 = Curve()
unit_z_3 = UnitZ(Factor=expr("2", 1))
extrude_2 = Extrude(Direction=unit_z_2)
shatter = Shatter(Curve=graft(curve_6), Parameters=shift_paths)  # -> flatten(Segments)
curve_14 = Curve(explode_tree_7.Branch1)
list_item_11 = ListItem(List=explode_tree_3._0000, Index=Slider(0, range=0..1), Wrap=True)
boundary_surfaces_2 = BoundarySurfaces(Edges=geometry_4)
point_list = PointList(Points=control_points.Points, Size=3)
brep_2 = Brep()
list_item_12 = ListItem(List=curve_13, Index=Slider(0, range=0..10), Wrap=True)
extrude_3 = Extrude(Base=geometry_5, Direction=unit_z_3)
list_item_13 = ListItem(List=curve_14, Index=Slider(2, range=0..10), Wrap=True)
cap_holes_ex = CapHolesEx(Brep=extrude_2)  # -> Brep, Caps, Solid
boundary_surfaces_3 = BoundarySurfaces(Edges=list_item_12)
join_curves = JoinCurves(Curves=shatter, Preserve=False)
boundary_surfaces_4 = BoundarySurfaces(Edges=list_item_13)
cap_holes_ex_2 = CapHolesEx(Brep=extrude_3)  # -> Brep, Caps, Solid
brep_curve = BrepCurve(Brep=boundary_surfaces_3, Curve=list_item_13)  # -> Curves, Points
curve_15 = Curve([<curve referenced from the Rhino model> x2])
region_intersection = RegionIntersection(CurvesA=list_item_12, CurvesB=list_item_13)
brep_brep = BrepBrep(BrepA=boundary_surfaces_3, BrepB=boundary_surfaces_4)  # -> Curves, Points
list_item_14 = ListItem(List=brep_2, Index=Slider(2, range=0..10), Wrap=True)
list_item_15 = ListItem(List=brep_2, Index=Slider(0, range=0..10), Wrap=True)
list_item_16 = ListItem(List=brep_2, Index=Slider(1, range=0..10), Wrap=True)
list_item_17 = ListItem(List=join_curves, Index=0, Wrap=True)
list_item_18 = ListItem(List=brep_curve.Curves, Index=Slider(1, range=0..10), Wrap=True)
control_polygon = ControlPolygon(Curve=list_item_13)  # -> Polygon, Points
polyline_offset = PolylineOffset(
    Polylines=join_curves,
    Distance=1,
    Plane=Plane(origin=(0, 0, 0), x=(0, 0, 0), y=(0, 0, 0)),
    Tolerance=0.01,
    ClosedFillet=2,
    OpenFillet=2,
    Miter=Slider(1, range=0..10))  # -> Contour, Holes
point_list_2 = PointList(Points=control_polygon.Points, Size=3)
curve_curve_2 = CurveCurve(CurveA=list_item_12, CurveB=list_item_13)  # -> Points, ParamsA, ParamsB
curve_16 = Curve(brep_brep.Curves)
panel_2 = Panel(brep_curve.Curves)
