# Grasshopper definition 1111_test.gh (Grasshopper 1.0.7)
# plug-ins: VolumeGeneratorBasedOnGraph

point = Point([Point(-174, 123, 0), Point(-139.7254121, 87.40785734, 0), Point(-97.02761901, 124.3107695, 0), Point(-107.5469207, 136.3854092, 0), Point(-119.6346799, 153.2947025, 0), Point(-138.2491307, 158.8896261, 0)])
point_2 = Point([Point(-135.4490472, 133.6098246, 0), Point(-11.23538893, 114.4173399, 0), Point(-121.3322609, 115.5276489, 0)])
point_list = PointList(Points=point, Size=Slider(9, range=0..10))
panel = Panel(point_2)
# // 代表N2
point_3 = Point(Point(-128, 163, 0))
# // 代表E1
point_4 = Point(Point(-133, 87, 0))
point_5 = Point(Point(-159, 158, 0))
# // 代表W
# // 代表S
point_6 = Point(Point(-174, 122, 0))
point_7 = Point(Point(-98, 108, 0))
# // 代表N1
point_8 = Point(Point(-103, 142, 0))
merge = Merge(Data1=point_6, Data2=point_4, Data3=point_7, Data4=point_8, Data5=point_3, Data6=point_5)
panel_2 = Panel(point)
point_9 = Point([Point(0, 25, 0), Point(-24, -1, 0), Point(15, -9, 0)])
point_10 = Point([Point(-89.84144518, -1, 0), Point(-14.56148622, -37.58938354, 0), Point(43.43890515, -17.78184047, 0), Point(61.40765386, 24.30146939, 0), Point(60.95274883, 59.53284046, 0), Point(0, 65.38519367, 0)])
point_list_2 = PointList(Points=merge, Size=Slider(5, range=0..10))
panel_3 = Panel("""W
S
E1
N1
E2
N2""")
file_path = FilePath("D:\毕业论文\VolumeGeneratorBasedOnGraph\VolumeGeneratorBasedOnGraph\测试文件夹\1024Test.csv")
constructgraph = ConstructGraph(CSVFilePath=file_path, VolumeNodePoints=point_9, BoundaryNodePoints=point_10, BoundaryNodeLabels=panel_3)
tutteconvexdrawing = TutteConvexDrawing(Graph=constructgraph)  # -> Graph, ConvexFaceBorders, SubGraph, GraphEdge
debuggraph = DebugGraph(Graph=tutteconvexdrawing.Graph)  # -> DebugGraphNode, DebugGraphLoL, DebugGraphVertex
panel_4 = Panel(debuggraph.DebugGraphNode)
panel_5 = Panel(debuggraph.DebugGraphLoL)
triangulate = Triangulate(
    Graph=tutteconvexdrawing.Graph,
    ConvexFaceBorders=tutteconvexdrawing.ConvexFaceBorders,
    IndexOfTriangularMesh=Slider(9, range=0..12),
    ExcludeDegenerateTINS=Toggle(True))
panel_6 = Panel(debuggraph.DebugGraphVertex)
decomposevertex = DecomposeVertex(GraphWithHM=triangulate, IndexOfGraphWithHM=Slider(2, range=0..26), IndexInItsGenealogy=Slider(2, range=0..2))  # -> CountOfAllPossibleGraphWithHM, SelectedGraphWithHM, SelectedAllPath, SelectedTreeNodeLabel, SelectedTreeNodeHistory, VolumeContainsWhichInnerNode
line = Line(Line((30, 50, 0), (30, 30, 0)))
line_2 = Line(Line((40, 40, 0), (50, 40, 0)))
line_3 = Line(Line((40, 40, 0), (40, 50, 0)))
line_4 = Line(Line((30, 50, 0), (40, 50, 0)))
line_5 = Line(Line((50, 40, 0), (50, 30, 0)))
line_6 = Line(Line((30, 30, 0), (50, 30, 0)))
constructboundarysegment = ConstructBoundarySegment(SelectedBoundaryPolylineSegment=line_4, SegmentLabel="N2")
constructboundarysegment_2 = ConstructBoundarySegment(SelectedBoundaryPolylineSegment=line_2, SegmentLabel="N1")
constructboundarysegment_3 = ConstructBoundarySegment(SelectedBoundaryPolylineSegment=line_3, SegmentLabel="E2")
constructboundarysegment_4 = ConstructBoundarySegment(SelectedBoundaryPolylineSegment=line_5, SegmentLabel="E1")
constructboundarysegment_5 = ConstructBoundarySegment(SelectedBoundaryPolylineSegment=line_6, SegmentLabel="S")
constructboundarysegment_6 = ConstructBoundarySegment(SelectedBoundaryPolylineSegment=line, SegmentLabel="W")
dualusinghalfedge2 = DualUsingHalfedge2(GraphWithHM=triangulate)
panel_7 = Panel(decomposevertex.VolumeContainsWhichInnerNode)
panel_8 = Panel(decomposevertex.SelectedTreeNodeHistory)
panel_9 = Panel(decomposevertex.SelectedTreeNodeLabel)
showgraph = ShowGraph(
    PlanktonMeshOrGraphWithHFMesh=dualusinghalfedge2,
    OffsetDistance=Slider(0.8, range=0..3),
    ScreenSize=Slider(32, range=0..50),
    RelativeSize=Slider(0, range=0..1))
merge_2 = Merge(
    Data1=constructboundarysegment_6,
    Data2=constructboundarysegment_5,
    Data3=constructboundarysegment_4,
    Data4=constructboundarysegment_2,
    Data5=constructboundarysegment_3,
    Data6=constructboundarysegment)
dualusinghalfedge = DualUsingHalfedge(GraphWithHM=decomposevertex.SelectedGraphWithHM)  # -> DualGraphWithHM, DebugVerticesOutput, DebugHalfedgesOutput, DebugFacesOutput, DebugFacesHalfedges
curve = Curve(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)
explode = Explode(Curve=curve, Recursive=True)  # -> Segments, Vertices
number_slider = Slider(3, range=0..100)
list_item = ListItem(List=explode.Segments, Index="5", Wrap=True)
list_item_2 = ListItem(List=explode.Segments, Index="4", Wrap=True)
list_item_3 = ListItem(List=explode.Segments, Index=" 0", Wrap=True)
list_item_4 = ListItem(List=explode.Segments, Index="3", Wrap=True)
list_item_5 = ListItem(List=explode.Segments, Index="2", Wrap=True)
list_item_6 = ListItem(List=explode.Segments, Index="1", Wrap=True)
ghcsplittest = GhcSplitTest(DualGraphWithHM=dualusinghalfedge.DualGraphWithHM, First=Slider(4, range=0..50))
line_7 = Line(list_item_3)
line_8 = Line(list_item_4)
line_9 = Line(list_item_5)
line_10 = Line(list_item_2)
line_11 = Line(list_item)
line_12 = Line(list_item_6)
constructboundarysegment_7 = ConstructBoundarySegment(SelectedBoundaryPolylineSegment=line_11, SegmentLabel="N2")
constructboundarysegment_8 = ConstructBoundarySegment(SelectedBoundaryPolylineSegment=line_8, SegmentLabel="N1")
constructboundarysegment_9 = ConstructBoundarySegment(SelectedBoundaryPolylineSegment=line_10, SegmentLabel="E2")
constructboundarysegment_10 = ConstructBoundarySegment(SelectedBoundaryPolylineSegment=line_9, SegmentLabel="E1")
constructboundarysegment_11 = ConstructBoundarySegment(SelectedBoundaryPolylineSegment=line_12, SegmentLabel="S")
constructboundarysegment_12 = ConstructBoundarySegment(SelectedBoundaryPolylineSegment=line_7, SegmentLabel="W")
showgraph_2 = ShowGraph(
    PlanktonMeshOrGraphWithHFMesh=ghcsplittest,
    OffsetDistance=Slider(0.8, range=0..3),
    ScreenSize=Slider(32, range=0..50),
    RelativeSize=Slider(0, range=0..1))
gene_pool = GenePool(Decimals=2, Maximum=1, Minimum=0, Value=[0.41, 0.43, 0.43])
merge_3 = Merge(
    Data1=constructboundarysegment_12,
    Data2=constructboundarysegment_11,
    Data3=constructboundarysegment_10,
    Data4=constructboundarysegment_8,
    Data5=constructboundarysegment_9,
    Data6=constructboundarysegment_7)
reorganizeboundary = ReorganizeBoundary(DualGraphWithHM=dualusinghalfedge.DualGraphWithHM, BoundarySegments=merge_3)  # -> DualGraphWithHM, ReorganizedBoundary, SubBoundarySegments, SortedBoundarySegments, BSIndexContainVolumeJunctions
reorganizeboundary2 = ReorganizeBoundary2(DualGraphWithHM=dualusinghalfedge2, BoundarySegments=merge_3)  # -> ReorganizedBoundary, SortedBoundarySegments, BSIndexContainVolumeJunctions, VolumeJunctionsTexts, PairVolumeJunctionsIndex
ghcsitedivision2 = GhcSiteDivision2(
    SortedBoundarySegments=reorganizeboundary2.SortedBoundarySegments,
    BSIndexContainVolumeJunctions=reorganizeboundary2.BSIndexContainVolumeJunctions,
    VolumeJunctionsTexts=reorganizeboundary2.VolumeJunctionsTexts,
    PairVolumeJunctionsIndex=reorganizeboundary2.PairVolumeJunctionsIndex,
    TList=gene_pool)
ghcsitedivision = GhcSiteDivision(
    DualGraphWithHM=reorganizeboundary.DualGraphWithHM,
    ReorganizedBoundary=reorganizeboundary.ReorganizedBoundary,
    SubBoundarySegments=reorganizeboundary.SubBoundarySegments)  # disabled
panel_10 = Panel("7")  # disabled
list_item_7 = ListItem(List=ghcsitedivision, Index=panel_10, Wrap=True)  # disabled
