# Grasshopper definition 1221.gh (Grasshopper 1.0.7)
# plug-ins: VolumeGeneratorBasedOnGraph

panel = Panel("""W
S
E
N""")
point = Point([Point(0, 25, 0), Point(-24, -1, 0), Point(15, -9, 0)])
point_2 = Point([Point(-58.07877569, -0.1938198873, 0), Point(1.315160513, -41.54792591, 0), Point(52.69083492, -0.1938198873, 0), Point(-1.182268104, 47.28917775, 0)])
file_path = FilePath("D:\毕业论文\VolumeGeneratorBasedOnGraph\VolumeGeneratorBasedOnGraph\测试文件夹\1221Test.csv")
constructgraph = ConstructGraph(CSVFilePath=file_path, VolumeNodePoints=point, BoundaryNodePoints=point_2, BoundaryNodeLabels=panel)
tutteconvexdrawing = TutteConvexDrawing(Graph=constructgraph)  # -> Graph, ConvexFaceBorders, SubGraph, GraphEdge
# 缺口形
curve = Curve(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)
# 正交矩形
# 四边形
curve_2 = Curve(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)
explode = Explode(Curve=curve_2, Recursive=True)  # -> Segments, Vertices
list_item = ListItem(List=explode.Segments, Index=" 0", Wrap=True)
list_item_2 = ListItem(List=explode.Segments, Index="3", Wrap=True)
list_item_3 = ListItem(List=explode.Segments, Index="2", Wrap=True)
list_item_4 = ListItem(List=explode.Segments, Index="1", Wrap=True)
line = Line(list_item)
line_2 = Line(list_item_2)
line_3 = Line(list_item_3)
line_4 = Line(list_item_4)
constructboundarysegment = ConstructBoundarySegment(SelectedBoundaryPolylineSegment=line_2, SegmentLabel="N")
constructboundarysegment_2 = ConstructBoundarySegment(SelectedBoundaryPolylineSegment=line_3, SegmentLabel="E")
constructboundarysegment_3 = ConstructBoundarySegment(SelectedBoundaryPolylineSegment=line_4, SegmentLabel="S")
constructboundarysegment_4 = ConstructBoundarySegment(SelectedBoundaryPolylineSegment=line, SegmentLabel="W")
merge = Merge(
    Data1=constructboundarysegment_4,
    Data2=constructboundarysegment_3,
    Data3=constructboundarysegment_2,
    Data4=constructboundarysegment)
triangulate = Triangulate(
    Graph=tutteconvexdrawing.Graph,
    ConvexFaceBorders=tutteconvexdrawing.ConvexFaceBorders,
    IndexOfTriangularMesh=Slider(0, range=0..12),
    ExcludeDegenerateTINS=Toggle(True))
dualusinghalfedge2 = DualUsingHalfedge2(GraphWithHM=triangulate)
reorganizeboundary3 = ReorganizeBoundary3(DualGraphWithHM=dualusinghalfedge2, BoundarySegments=merge)  # -> SortedBoundarySegments, VerticesIndexForEachBS, IndexOnEachBS, VolumeJunctionsTexts, NeedToConnectVolumeJunctionsIndex, NeedToConnectBSIndex, NeedToConnectPairCorrespondingFaceIndex, BoundaryTCounts, InnerTMaxCounts, TotalLayerCount
gene_pool = GenePool(Decimals=2, Maximum=1, Minimum=0, Value=1)
gene_pool_2 = GenePool(Decimals=2, Maximum=1, Minimum=0, Value=[0.33, 0.46, 0.43])
entwine = Entwine(Branch00=gene_pool_2, FlattenInputs=True)
entwine_2 = Entwine(Branch00=gene_pool, FlattenInputs=True)
ghcsitedivision3 = GhcSiteDivision3(
    DualGraphWithHM=dualusinghalfedge2,
    SortedBoundarySegments=reorganizeboundary3.SortedBoundarySegments,
    VerticesIndexForEachBS=reorganizeboundary3.VerticesIndexForEachBS,
    IndexOnEachBS=reorganizeboundary3.IndexOnEachBS,
    VolumeJunctionsTexts=reorganizeboundary3.VolumeJunctionsTexts,
    NeedToConnectVolumeJunctionsIndex=reorganizeboundary3.NeedToConnectVolumeJunctionsIndex,
    NeedToConnectBSIndex=reorganizeboundary3.NeedToConnectBSIndex,
    NeedToConnectPairCorrespondingFaceIndex=reorganizeboundary3.NeedToConnectPairCorrespondingFaceIndex,
    BoundaryTCounts=reorganizeboundary3.BoundaryTCounts,
    InnerTMaxCounts=reorganizeboundary3.InnerTMaxCounts,
    TotalLayerCount=reorganizeboundary3.TotalLayerCount,
    BoundaryTDT=entwine,
    InnerTMaxDT=entwine_2)  # -> TXDT, TYDT, DeBugPolyline
unit_z = UnitZ(Factor=1)
extrude = Extrude(Base=curve_2, Direction=unit_z)
curve_3 = Curve(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)
curve_4 = Curve(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)
cap_holes = CapHoles(Brep=extrude)
bounding_box = BoundingBox(Content=curve_2, Plane=PlaneXY(0, 0, 0))  # -> Box, Box_2
boundary_surfaces = BoundarySurfaces(Edges=curve_3)  # -> reparameterize(Surfaces)
brep_wireframe = BrepWireframe(Brep=curve_3, Density=-1)
box = Box(cap_holes)
construct_domain = ConstructDomain(DomainStart=0, DomainEnd=1)
list_item_5 = ListItem(List=brep_wireframe, Index=Slider(2, range=0..10), Wrap=True)
list_item_6 = ListItem(List=brep_wireframe, Index=Slider(3, range=0..10), Wrap=True)
list_item_7 = ListItem(List=brep_wireframe, Index=Slider(1, range=0..10), Wrap=True)
list_item_8 = ListItem(List=brep_wireframe, Index=Slider(0, range=0..10), Wrap=True)
flip_curve = FlipCurve(Curve=list_item_8)  # -> Curve, Flag
flip_curve_2 = FlipCurve(Curve=list_item_6)  # -> Curve, Flag
merge_2 = Merge(Data1=flip_curve.Curve, Data2=list_item_5)
sweep2 = Sweep2(Rail1=list_item_7, Rail2=flip_curve_2.Curve, Sections=merge_2, SameHeight=False)
surface = Surface(reparameterize(sweep2))
surface_morph = SurfaceMorph(
    Geometry=ghcsitedivision3.DeBugPolyline,
    Reference=box,
    Surface=surface,
    UDomain=construct_domain,
    VDomain=construct_domain,
    WDomain=construct_domain)
list_item_9 = ListItem(List=surface_morph, Index=Slider(0, range=0..10), Wrap=True)
list_item_10 = ListItem(List=surface_morph, Index=Slider(1, range=0..10), Wrap=True)
list_item_11 = ListItem(List=surface_morph, Index=Slider(2, range=0..10), Wrap=True)
divide_surface = DivideSurface(UCount=10, VCount=10)  # -> Points, Normals, Parameters
volumegenerator1 = VolumeGenerator1(BoundaryPline=list_item_9, Interval=Slider(4, range=0..10), SetBack=Slider(2, range=0..10), Width=Slider(2, range=0..10))  # -> DeterminantBuildingOutput, BlockBuildingOutput, SetBackCurve, DeterminantLayoutLine, BlockLayoutLine
volumegenerator1_2 = VolumeGenerator1(
    BoundaryPline=list_item_10,
    Interval=Slider(4, range=0..10),
    SetBack=Slider(2, range=0..10),
    Width=Slider(2, range=0..10))  # -> DeterminantBuildingOutput, BlockBuildingOutput, SetBackCurve, DeterminantLayoutLine, BlockLayoutLine
volumegenerator1_3 = VolumeGenerator1(
    BoundaryPline=list_item_11,
    Interval=Slider(4, range=0..10),
    SetBack=Slider(2, range=0..10),
    Width=Slider(2, range=0..10))  # -> DeterminantBuildingOutput, BlockBuildingOutput, SetBackCurve, DeterminantLayoutLine, BlockLayoutLine
list_length = ListLength(List=divide_surface.Parameters)
flip_matrix = FlipMatrix(Data=divide_surface.Points)  # -> flatten(Data)
list_item_12 = ListItem(List=flatten(list_length), Index=0, Wrap=True)
surface_from_points = SurfaceFromPoints(Points=flip_matrix, UCount=list_item_12, Interpolate=False)  # -> reparameterize(Surface)
geometry = Geometry(volumegenerator1.DeterminantBuildingOutput)
curve_5 = Curve(volumegenerator1.BlockLayoutLine)
geometry_2 = Geometry(volumegenerator1.BlockBuildingOutput)
curve_6 = Curve(volumegenerator1.SetBackCurve)
curve_7 = Curve(volumegenerator1.DeterminantLayoutLine)
geometry_3 = Geometry(volumegenerator1_2.DeterminantBuildingOutput)
curve_8 = Curve(volumegenerator1_2.BlockLayoutLine)
curve_9 = Curve(volumegenerator1_2.SetBackCurve)
curve_10 = Curve(volumegenerator1_2.DeterminantLayoutLine)
geometry_4 = Geometry(volumegenerator1_2.BlockBuildingOutput)
geometry_5 = Geometry(volumegenerator1_3.DeterminantBuildingOutput)
curve_11 = Curve(volumegenerator1_3.BlockLayoutLine)
geometry_6 = Geometry(volumegenerator1_3.BlockBuildingOutput)
curve_12 = Curve(volumegenerator1_3.SetBackCurve)
curve_13 = Curve(volumegenerator1_3.DeterminantLayoutLine)
