# Grasshopper definition 1230_2.gh (Grasshopper 1.0.7)
# plug-ins: VolumeGeneratorBasedOnGraph

panel = Panel("""W
S
E
N""")
point = Point([Point(7.702211489, 28.53651013, 0), Point(-22.57115831, 12.52318325, 0), Point(-14.73982327, -17.28264416, 0), Point(21.26094082, -9.451309116, 0), Point(7.000897903, 13.57515363, 0), Point(-9.713742566, 10.30235689, 0), Point(-0.2460091537, 0.6008522846, 0)])
point_2 = Point([Point(-58.07877569, -0.1938198873, 0), Point(1.315160513, -41.54792591, 0), Point(52.69083492, -0.1938198873, 0), Point(-1.182268104, 47.28917775, 0)])
file_path = FilePath("D:\毕业论文\VolumeGeneratorBasedOnGraph\VolumeGeneratorBasedOnGraph\测试文件夹\1230Test_2.csv")
constructgraph = ConstructGraph(CSVFilePath=file_path, VolumeNodePoints=point, BoundaryNodePoints=point_2, BoundaryNodeLabels=panel)
tutteconvexdrawing = TutteConvexDrawing(Graph=constructgraph)  # -> Graph, ConvexFaceBorders, SubGraph, GraphEdge
curve = Curve(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)
curve_2 = Curve(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)
explode = Explode(Curve=curve_2, Recursive=True)  # -> Segments, Vertices
list_item = ListItem(List=explode.Segments, Index=" 0", Wrap=True)
list_item_2 = ListItem(List=explode.Segments, Index="3", Wrap=True)
list_item_3 = ListItem(List=explode.Segments, Index="2", Wrap=True)
list_item_4 = ListItem(List=explode.Segments, Index="1", Wrap=True)
triangulate = Triangulate(
    Graph=tutteconvexdrawing.Graph,
    ConvexFaceBorders=tutteconvexdrawing.ConvexFaceBorders,
    IndexOfTriangularMesh=Slider(0, range=0..12),
    ExcludeDegenerateTINS=Toggle(True))
line = Line(list_item)
line_2 = Line(list_item_2)
line_3 = Line(list_item_3)
line_4 = Line(list_item_4)
constructboundarysegment = ConstructBoundarySegment(SelectedBoundaryPolylineSegment=line_2, SegmentLabel="N")
constructboundarysegment_2 = ConstructBoundarySegment(SelectedBoundaryPolylineSegment=line_3, SegmentLabel="E")
constructboundarysegment_3 = ConstructBoundarySegment(SelectedBoundaryPolylineSegment=line_4, SegmentLabel="S")
constructboundarysegment_4 = ConstructBoundarySegment(SelectedBoundaryPolylineSegment=line, SegmentLabel="W")
dualusinghalfedge2 = DualUsingHalfedge2(GraphWithHM=triangulate)
merge = Merge(
    Data1=constructboundarysegment_4,
    Data2=constructboundarysegment_3,
    Data3=constructboundarysegment_2,
    Data4=constructboundarysegment)
reorganizeboundary3 = ReorganizeBoundary3(DualGraphWithHM=dualusinghalfedge2, BoundarySegments=merge)  # -> SortedBoundarySegments, VerticesIndexForEachBS, IndexOnEachBS, VolumeJunctionsTexts, NeedToConnectVolumeJunctionsIndex, NeedToConnectBSIndex, NeedToConnectPairCorrespondingFaceIndex, BoundaryTCounts, InnerTMaxCounts, TotalLayerCount
gene_pool = GenePool(Decimals=2, Maximum=1, Minimum=0, Value=[0.34, 0.63, 0.45])
gene_pool_2 = GenePool(Decimals=2, Maximum=1, Minimum=0, Value=[0.61, 0.59])
gene_pool_3 = GenePool(Decimals=2, Maximum=1, Minimum=0, Value=[0.68, 0.52, 0.21, 0.75])
gene_pool_4 = GenePool(Decimals=2, Maximum=1, Minimum=0, Value=[0.37, 0.38, 0.69])
entwine = Entwine(Branch00=gene_pool_2, Branch01=gene_pool_4, FlattenInputs=True)
entwine_2 = Entwine(Branch00=gene_pool_3, Branch01=gene_pool, FlattenInputs=True)
ghcsitedivision3 = GhcSiteDivision3(
    DualGraphWithHM=dualusinghalfedge2,
    SortedBoundarySegments=reorganizeboundary3.SortedBoundarySegments,
    VerticesIndexForEachBS=reorganizeboundary3.VerticesIndexForEachBS,
    IndexOnEachBS=reorganizeboundary3.IndexOnEachBS,
    VolumeJunctionsTexts=reorganizeboundary3.VolumeJunctionsTexts,
    NeedToConnectVolumeJunctionsIndex=reorganizeboundary3.NeedToConnectVolumeJunctionsIndex,
    NeedToConnectBSIndex=reorganizeboundary3.NeedToConnectBSIndex,
    NeedToConnectPairCorrespondingFaceIndex=reorganizeboundary3.NeedToConnectPairCorrespondingFaceIndex,
    BoundaryTCounts=reorganizeboundary3.BoundaryTCounts,
    InnerTMaxCounts=reorganizeboundary3.InnerTMaxCounts,
    TotalLayerCount=reorganizeboundary3.TotalLayerCount,
    BoundaryTDT=entwine_2,
    InnerTMaxDT=entwine)  # -> TXDT, TYDT, DeBugPolyline
