# Grasshopper definition 综合体案例.gh (Grasshopper 1.0.7)
# plug-ins: VolumeGeneratorBasedOnGraph

# ---- group: 图结构构造
point = Point([Point(0, 25, 0), Point(-24, -1, 0), Point(15, -9, 0)])
point_2 = Point([Point(-58.07877569, -0.1938198873, 0), Point(1.315160513, -41.54792591, 0), Point(52.69083492, -0.1938198873, 0), Point(-1.182268104, 47.28917775, 0)])
panel = Panel("""W
S
E
N""")
file_path = FilePath("D:\毕业论文\VolumeGeneratorBasedOnGraph\VolumeGeneratorBasedOnGraph\测试文件夹\综合体拓扑关系.csv")
constructgraph = ConstructGraph(CSVFilePath=file_path, VolumeNodePoints=point, BoundaryNodePoints=point_2, BoundaryNodeLabels=panel)

# ---- group: Tutte嵌入
tutteconvexdrawing = TutteConvexDrawing(Graph=constructgraph)  # -> Graph, ConvexFaceBorders, SubGraph, GraphEdge

# ---- group: 穷尽隐藏拓扑可能性
triangulate = Triangulate(
    Graph=tutteconvexdrawing.Graph,
    ConvexFaceBorders=tutteconvexdrawing.ConvexFaceBorders,
    IndexOfTriangularMesh=Slider(0, range=0..12),
    ExcludeDegenerateTINS=Toggle(True))

# ---- group: 对偶图生成
dualusinghalfedge2 = DualUsingHalfedge2(GraphWithHM=triangulate)

# ---- group: 场地边界整理
curve = Curve(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)
explode = Explode(Curve=curve, Recursive=True)  # -> Segments, Vertices
list_item = ListItem(List=explode.Segments, Index=" 0", Wrap=True)
list_item_2 = ListItem(List=explode.Segments, Index="3", Wrap=True)
list_item_3 = ListItem(List=explode.Segments, Index="2", Wrap=True)
list_item_4 = ListItem(List=explode.Segments, Index="1", Wrap=True)
line = Line(list_item)
line_2 = Line(list_item_2)
line_3 = Line(list_item_3)
line_4 = Line(list_item_4)
constructboundarysegment = ConstructBoundarySegment(SelectedBoundaryPolylineSegment=line_2, SegmentLabel="N")
constructboundarysegment_2 = ConstructBoundarySegment(SelectedBoundaryPolylineSegment=line_3, SegmentLabel="E")
constructboundarysegment_3 = ConstructBoundarySegment(SelectedBoundaryPolylineSegment=line_4, SegmentLabel="S")
constructboundarysegment_4 = ConstructBoundarySegment(SelectedBoundaryPolylineSegment=line, SegmentLabel="W")
merge = Merge(
    Data1=constructboundarysegment_4,
    Data2=constructboundarysegment_3,
    Data3=constructboundarysegment_2,
    Data4=constructboundarysegment)
reorganizeboundary3 = ReorganizeBoundary3(DualGraphWithHM=dualusinghalfedge2, BoundarySegments=merge)  # -> SortedBoundarySegments, Shift, VerticesIndexForEachBS, IndexOnEachBS, VolumeJunctionsTexts, NeedToConnectVolumeJunctionsIndex, NeedToConnectBSIndex, NeedToConnectPairCorrespondingFaceIndex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

# ---- group: 场地划分
gene_pool = GenePool(Decimals=2, Maximum=1, Minimum=0, Value=1)
gene_pool_2 = GenePool(Decimals=2, Maximum=1, Minimum=0, Value=[0.33, 0.46, 0.43])
entwine = Entwine(Branch00=gene_pool_2, FlattenInputs=True)
entwine_2 = Entwine(Branch00=gene_pool, FlattenInputs=True)
ghcsitedivision3 = GhcSiteDivision3(
    DualGraphWithHM=dualusinghalfedge2,
    SortedBoundarySegments=reorganizeboundary3.SortedBoundarySegments,
    Shift=reorganizeboundary3.Shift,
    VerticesIndexForEachBS=reorganizeboundary3.VerticesIndexForEachBS,
    IndexOnEachBS=reorganizeboundary3.IndexOnEachBS,
    VolumeJunctionsTexts=reorganizeboundary3.VolumeJunctionsTexts,
    NeedToConnectVolumeJunctionsIndex=reorganizeboundary3.NeedToConnectVolumeJunctionsIndex,
    NeedToConnectBSIndex=reorganizeboundary3.NeedToConnectBSIndex,
    NeedToConnectPairCorrespondingFaceIndex=reorganizeboundary3.NeedToConnectPairCorrespondingFaceIndex,
    BoundaryTCounts=reorganizeboundary3.BoundaryTCounts,
    InnerTMaxCounts=reorganizeboundary3.InnerTMaxCounts,
    TotalLayerCount=reorganizeboundary3.TotalLayerCount,
    BoundaryTDT=entwine,
    InnerTMaxDT=entwine_2)  # -> TXDT, TYDT, DualGraphWithHM, DualPlanktonMesh

# ---- group: 划分结果重映射
curve_2 = Curve(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)
brep_wireframe = BrepWireframe(Brep=curve_2, Density=-1)
list_item_5 = ListItem(List=brep_wireframe, Index=Slider(3, range=0..10), Wrap=True)
list_item_6 = ListItem(List=brep_wireframe, Index=Slider(1, range=0..10), Wrap=True)
list_item_7 = ListItem(List=brep_wireframe, Index=Slider(0, range=0..10), Wrap=True)
list_item_8 = ListItem(List=brep_wireframe, Index=Slider(2, range=0..10), Wrap=True)
unit_z = UnitZ(Factor=1)
flip_curve = FlipCurve(Curve=list_item_7)  # -> Curve, Flag
flip_curve_2 = FlipCurve(Curve=list_item_5)  # -> Curve, Flag
extrude = Extrude(Base=curve, Direction=unit_z)
merge_2 = Merge(Data1=flip_curve.Curve, Data2=list_item_8)
construct_domain = ConstructDomain(DomainStart=0, DomainEnd=1)
sweep2 = Sweep2(Rail1=list_item_6, Rail2=flip_curve_2.Curve, Sections=merge_2, SameHeight=False)
cap_holes = CapHoles(Brep=extrude)
surface = Surface(reparameterize(sweep2))
box = Box(cap_holes)
divisionmorph = DivisionMorph(
    DualPlanktonMesh=ghcsitedivision3.DualPlanktonMesh,
    Reference=box,
    Surface=surface,
    UDomain=construct_domain,
    VDomain=construct_domain,
    WDomain=construct_domain)

# ---- group: 体量生成与指标控制
# W
# S
# E
# N
# default
number_slider = Slider(5, range=0..10)
merge_3 = Merge(
    Data1=Slider(8, range=0..10),
    Data2=number_slider,
    Data3=Slider(8, range=0..10),
    Data4=Slider(12, range=0..15),
    Data5=Slider(13, range=0..20))

# ---- group: 体量生成与指标控制 / l
merge_4 = Merge(Data1=Slider(24, range=0..50), Data2=Slider(24, range=0..50), Data3=Slider(24, range=0..50))

# ---- group: 体量生成与指标控制 / Proportion
merge_5 = Merge(Data1=Slider(0.6, range=0..1), Data2=Slider(0.6, range=0..1), Data3=Slider(0.6, range=0..1))

# ---- group: 体量生成与指标控制 / AreaRatio
merge_6 = Merge(Data1=Slider(3, range=0..5), Data2=Slider(3, range=0..3), Data3=Slider(3, range=0..3))

# ---- group: 体量生成与指标控制 / Density
merge_7 = Merge(Data1=Slider(0.393, range=0..1), Data2=Slider(0.36, range=0..1), Data3=Slider(0.346, range=0..1))

# ---- group: 体量生成与指标控制
number_slider_2 = Slider(1, range=0..10)
gene_pool_3 = GenePool(Decimals=1, Maximum=5, Minimum=-5, Value=[-5, 0])
gene_pool_4 = GenePool(Decimals=0, Maximum=2, Minimum=0, Value=[0, 1])
value_list = ValueList({"多层": 0, "多层高层混合": 1}, selected="多层高层混合")
entwine_3 = Entwine(Branch0X=gene_pool_4, FlattenInputs=False)
entwine_4 = Entwine(Branch0X=gene_pool_3, FlattenInputs=False)
multiplication = Multiplication(A=merge_4, B=number_slider_2)

# ---- group: 体量生成与指标控制 / d
multiplication_2 = Multiplication(A=Slider(13, range=0..20), B=number_slider_2)

# ---- group: 体量生成与指标控制 / lMax
multiplication_3 = Multiplication(A=Slider(60, range=0..100), B=number_slider_2)

# ---- group: 体量生成与指标控制 / FloorHeight
multiplication_4 = Multiplication(A=Slider(4, range=0..5), B=number_slider_2)

# ---- group: 体量生成与指标控制 / lMin
multiplication_5 = Multiplication(A=Slider(30, range=0..50), B=number_slider_2)

# ---- group: 体量生成与指标控制 / w
multiplication_6 = Multiplication(A=Slider(20, range=0..50), B=number_slider_2)

# ---- group: 体量生成与指标控制 / W
multiplication_7 = Multiplication(A=Slider(24, range=0..50), B=number_slider_2)

# ---- group: 体量生成与指标控制 (continued)
volumebaseontopo = VolumeBaseOnTopo(
    DualGraphWithHM=ghcsitedivision3.DualGraphWithHM,
    NewDualPlanktonMesh=divisionmorph,
    WhichPairSetbackNeedToChange=entwine_3,
    SetbackValueNeedToChange=entwine_4,
    SetbackList=merge_3,
    W=multiplication_6,
    W_2=multiplication_7,
    LMin=multiplication_5,
    LMax=multiplication_3,
    D=multiplication_2,
    FloorHeight=multiplication_4,
    Density=merge_7,
    AreaRatio=merge_6,
    Seed=Slider(4, range=0..10),
    IsJitter=Toggle(False),
    GenerateMode=value_list,
    Proportion=merge_5,
    L=multiplication)  # -> DualGraphWithHMWithBS, SetBackPolyline, Building, Contours, Holes, HCurves, VCurves

# ----
brep = Brep(volumebaseontopo.Building)
shift_paths = ShiftPaths(Data=brep, Offset="-2")
volume_moments = VolumeMoments(Geometry=shift_paths)  # -> Volume, Centroid, Inertia, InertiaError, Secondary, SecondaryError, Gyration
mass_addition = MassAddition(Input=volume_moments.Volume)  # -> Result, PartialResults
panel_2 = Panel(volume_moments.Volume)
panel_3 = Panel(mass_addition.Result)
division = Division(A=mass_addition.Result, B=multiplication_4)
panel_4 = Panel(division)
